# Grasshopper definition 210815_trvr.gh (Grasshopper 1.0.7)

box = Box2Pt(PointA="20,0,0", PointB="30,10,3", Plane=PlaneXY(0, 0, 0))
box_2 = Box2Pt(PointA="0,0,0", PointB="10,10,3", Plane=PlaneXY(0, 0, 0))
box_3 = Box2Pt(PointA="10,0,0", PointB="20,10,3", Plane=PlaneXY(0, 0, 0))
merge = Merge(Data1=box_2, Data2=box_3, Data3=box)
panel = Panel("""Spaces_All_Values
Spaces_No_Values
No_Spaces""")
roomsolid = HBRoomFromSolid(geo=flatten(merge), name=panel, conditioned=True)  # -> report, rooms; plug-in component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
toggle = BooleanToggle(True)
solveadj = HBSolveAdjacency(rooms=flatten(roomsolid.rooms), overwrite=toggle, run=toggle)  # -> report, adj_rooms; plug-in component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
aperturesbyratio = HBAperturesByRatio(hb_objs=flatten(solveadj.adj_rooms), ratio="0.2")  # -> report, hb_objs; plug-in component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

ghpython_script = GhPythonScript(rooms=roomsolid.rooms)  # -> out, a; inputs rooms: list
# ---------- ghpython_script: Python ----------
__author__ = "TREVOR"
__version__ = "2021.08.09"

import rhinoscriptsyntax as rs

rmFA=[]

a = [room.floor_area for room in _rooms]
# ---------- end ghpython_script ----------
pipeline = GeometryPipeline(
    GroupByLayer=False,
    GroupByType=False,
    IncludeHidden=True,
    IncludeLocked=True,
    LayerFilter="Default",
    NameFilter="*",
    SublayerFiltering=True,
    TypeFilter=1073741885)
area = Area(Geometry=pipeline)  # -> Area, Centroid

extrude = Extrude(B=pipeline)
brep = Brep(extrude)

panel_2 = Panel(ghpython_script.a)
panel_3 = Panel(area.Area)

partition = PartitionList(List=brep, Size="2")
item = ListItem(List=partition, Index="0", Wrap=True)  # -> flatten(Item)

opaquemat = HBOpaqueMaterial(name="TestMatter", thickness=".15", conductivity=".04", density="50", spec_heat="1234")  # -> mat; plug-in component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
opaquemat_2 = HBOpaqueMaterial(name="TestMatter1", thickness=".09", conductivity=".1", density="75", spec_heat="1111")  # -> mat; plug-in component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
list = ValueList({"1-Honeybee Program", "2-User Determined"}, selected="2-User Determined")
ghpython_script_2 = GhPythonScript(mat=opaquemat)  # -> out, a
# ---------- ghpython_script_2: Python ----------
import rhinoscriptsyntax as rs
import Grasshopper.Kernel as ghK

import LBT_Utils
reload(LBT_Utils)

import PHX
import PHX._base
import PHX.serialization.to_dict
import PHX.serialization.from_dict

import PHX.assemblies

reload(PHX)
reload(PHX._base)
reload(PHX.assemblies)
reload(PHX.serialization.to_dict)
reload(PHX.serialization.from_dict)

import PyPH_Rhino
import PyPH_Rhino.gh_utils
reload(PyPH_Rhino)
reload(PyPH_Rhino.gh_utils)

mat_prop_dict = {}

if _mat:
    phx_mat = PHX.assemblies.Material()
    phx_mat.n = _mat.display_name
    phx_mat.tConD = _mat.conductivity
    phx_mat.densB = _mat.density
    phx_mat.hCapS = _mat.specific_heat
    
    
PyPH_Rhino.gh_utils.object_preview( phx_mat )
# ---------- end ghpython_script_2 ----------
opaqueconstr = HBOpaqueConstruction(name="TestAssy", materials=[opaquemat, opaquemat_2])  # -> constr; plug-in component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
geometry = Geometry(<brep referenced from the Rhino model>)
deconstruct_brep = DeconstructBrep(Brep=geometry)  # -> Faces, Edges, Vertices
face = HBFace(geo=deconstruct_brep.Faces, ep_constr=opaqueconstr)  # -> out, faces; plug-in component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
room = HBRoom(faces=flatten(face.faces), name="myTestRoom", conditioned=True)  # -> out, room; plug-in component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
ghpython_script_3 = GhPythonScript(material=opaquemat)  # -> out, a
# ---------- ghpython_script_3: Python ----------
"""WIP for adding WP props to mats in a couple different ways.
    Inputs:
        _material: A HB Material to add props to 
        _material_name: display_name of the mat to add props
        _HB_Rooms: HB Rooms with constructions containing mats to add props to
        _propList: a list, to be a list of lists i for i with mat to give props
                   Porosity, diffusion resistance, reference water content, free water saturation (To be cont)
"""

ghenv.Component.Message = "Add WP Mat Props"
# ---------- end ghpython_script_3 ----------
ghpython_script_4 = GhPythonScript(HB_rooms=aperturesbyratio.hb_objs)  # -> out, a; inputs HB_rooms: list
# ---------- ghpython_script_4: Python ----------
import rhinoscriptsyntax as rs
import Grasshopper.Kernel as ghK

import LBT_Utils
reload(LBT_Utils)

import PHX
import PHX._base
import PHX.serialization.to_dict
import PHX.serialization.from_dict

import PHX.assemblies

reload(PHX)
reload(PHX._base)
reload(PHX.assemblies)
reload(PHX.serialization.to_dict)
reload(PHX.serialization.from_dict)

import PyPH_Rhino
import PyPH_Rhino.gh_utils
reload(PyPH_Rhino)
reload(PyPH_Rhino.gh_utils)


try:  # import the core honeybee dependencies
    from honeybee.boundarycondition import Outdoors
    from honeybee.facetype import Wall
    from honeybee.room import Room
    from honeybee.face import Face
    from honeybee.door import Door
    from honeybee.orientation import angles_from_num_orient, face_orient_index
except ImportError as e:
    raise ImportError('\nFailed to import honeybee:\n\t{}'.format(e))

import json



assylst = []
if _HB_rooms:
    objs_hb = [obj.duplicate() for obj in _HB_rooms]
    for obj in objs_hb:
        if isinstance(obj, Room):
            for face in obj.faces:
                assylst.append(cons for cons in face.properties.energy.construction)
                a = face.properties.energy.construction.to_dict()
                #print(a.keys())
                
                a = json.dumps(a, indent=2)
                print(a)
                





"""
mat_prop_dict = {}

if _mat:
    phx_mat = PHX.assemblies.Material()
    phx_mat.n = _mat.display_name
    phx_mat.tConD = _mat.conductivity
    phx_mat.densB = _mat.density
    phx_mat.hCapS = _mat.specific_heat
    
    
PyPH_Rhino.gh_utils.object_preview( phx_mat )
"""
# ---------- end ghpython_script_4 ----------
panel_4 = Panel(ghpython_script_4.a)
python = GhPythonScript(floor_surfaces=pipeline, space_geometry=brep, HB_rooms=aperturesbyratio.hb_objs, ventilation_rates=list)  # -> out, floor_surface_breps, volume_geometry_breps, HB_rooms; inputs floor_surfaces: list, space_geometry: list, HB_rooms: list
# ---------- python: Python ----------
import scriptcontext as sc
import Rhino as rh
import rhinoscriptsyntax as rs
import ghpythonlib.components as ghc
import Grasshopper as gh


import LBT_Utils
reload(LBT_Utils)

import PHX
import PHX._base
import PHX.utilization_patterns
import PHX.hvac
import PHX.geometry
import PHX.spaces
import PHX.serialization.to_dict
import PHX.serialization.from_dict

reload(PHX)
reload(PHX._base)
reload(PHX.utilization_patterns)
reload(PHX.hvac)
reload(PHX.geometry)
reload(PHX.spaces)
reload(PHX.serialization.to_dict)
reload(PHX.serialization.from_dict)

import PyPH_Rhino
import PyPH_Rhino.gh_io
import PyPH_Rhino.spaces
import PyPH_Rhino.space_floors
import PyPH_Rhino.space_volumes
import PyPH_Rhino.space_io

reload(PyPH_Rhino)
reload(PyPH_Rhino.gh_io)
reload(PyPH_Rhino.spaces)
reload(PyPH_Rhino.space_floors)
reload(PyPH_Rhino.space_volumes)
reload(PyPH_Rhino.space_io)


"""
DEV = True
if DEV:
    sc.sticky.get('PyPH_Update_PHX', lambda : None)()
    sc.sticky.get('PyPH_Update_PyPH', lambda : None)()
"""

IGH = PyPH_Rhino.gh_io.IGH( ghdoc, ghenv, sc, rh, rs, ghc, gh )

#--- Main
if _HB_rooms:
    floors_dict, floor_surface_breps_ = PyPH_Rhino.spaces.build_floors(IGH,
                                    _floor_surfaces, '_floor_surfaces', _HB_rooms)
    volumes, volume_geometry_breps_ = PyPH_Rhino.spaces.build_volumes(IGH, 
                                    floors_dict, _space_geometry, '_space_geometry')
    spaces = PyPH_Rhino.spaces.build_spaces(volumes)

#-- Set the Space Ventilation Rates from Honeybee
if '1' in str(_ventilation_rates):
    for d in spaces.values():
        hb_room = d['hb_room']
        hb_room_vent_flow_m3h = LBT_Utils.program.calc_HB_Room_total_ventilation_m3sec( hb_room ) * 3600
        
        space_dict = d.get('Spaces')
        for space in space_dict:
            space.ventilation.airflows.supply = hb_room_vent_flow_m3h
            space.ventilation.airflows.extract = hb_room_vent_flow_m3h
            space.ventilation.airflows.transfer = 0.0

#--- Pack up all the results onto the HB Rooms
HB_rooms_ = []
for hb_room in _HB_rooms:
    new_hb_room = hb_room.duplicate()
    
    spaces_dict = {}
    for space in spaces.get(hb_room.identifier, {}).get('Spaces', []):
        spaces_dict.update( { id(space):space.to_dict() } )
    
    new_hb_room = LBT_Utils.user_data.add_to_HB_Obj_user_data(new_hb_room,
                                    spaces_dict, 'spaces', _write_mode='overwrite')
    
    HB_rooms_.append(new_hb_room)
# ---------- end python ----------
apply_ventilation_schedule = GhPythonScript(
    name="My Test",
    fan_speed_at_high="1.00",
    hours_at_high="12",
    fan_speed_at_normal="0.77",
    hours_at_normal="12",
    HB_rooms=python.HB_rooms)  # -> out, ventilation_schedule, HB_rooms; inputs HB_rooms: list
# ---------- apply_ventilation_schedule: Python ----------
import Grasshopper.Kernel as ghK

import LBT_Utils
reload(LBT_Utils)

import PHX
import PHX._base
import PHX.utilization_patterns
import PHX.hvac
import PHX.geometry
import PHX.spaces
import PHX.serialization.to_dict
import PHX.serialization.from_dict

reload(PHX)
reload(PHX._base)
reload(PHX.utilization_patterns)
reload(PHX.hvac)
reload(PHX.geometry)
reload(PHX.spaces)
reload(PHX.serialization.to_dict)
reload(PHX.serialization.from_dict)

import PyPH_Rhino
import PyPH_Rhino.gh_utils
reload(PyPH_Rhino)
reload(PyPH_Rhino.gh_utils)

HB_rooms_ = []
if _HB_rooms:
    #-- Create the new Ventilation Utilization Pattern
    ventilation_schedule_ = PHX.utilization_patterns.UtilizationPattern_Ventilation()
    
    ventilation_schedule_.n = _name or 'unnamed schedule'
    
    ventilation_schedule_.utilizations.maximum.frac_of_design_airflow = _fan_speed_at_high or 0
    ventilation_schedule_.utilizations.maximum.daily_op_sched = _hours_at_high or 0
    
    ventilation_schedule_.utilizations.standard.frac_of_design_airflow = _fan_speed_at_normal or 0
    ventilation_schedule_.utilizations.standard.daily_op_sched = _hours_at_normal or 0
    
    ventilation_schedule_.utilizations.basic.frac_of_design_airflow = _fan_speed_at_low or 0
    ventilation_schedule_.utilizations.basic.daily_op_sched = _hours_at_low or 0
    
    ventilation_schedule_.utilizations.minimum.frac_of_design_airflow = _fan_speed_at_minimum or 0
    ventilation_schedule_.utilizations.minimum.daily_op_sched = _hours_at_minimum or 0
    
    #--- Validate the Inputs
    msg = ventilation_schedule_.validate_total_hours()
    if msg:
        ghenv.Component.AddRuntimeMessage(ghK.GH_RuntimeMessageLevel.Warning, msg)
    
    
    #-- Add the Ventilation Pattern to all the input HB Rooms
    for room in _HB_rooms:
        new_hb_room = room.duplicate()
        
        spaces_dict = {}
        for space in room.user_data.get('phx', {}).get('spaces', {}).values():
            #-- Update the Space properties
            space_obj = PHX.spaces.Space.from_dict(space)
            
            space_obj.ventilation.utilization_pattern = ventilation_schedule_
            spaces_dict.update( {id(space_obj):space_obj.to_dict()} )
    
        new_hb_room = LBT_Utils.user_data.add_to_HB_Obj_user_data(new_hb_room,
                                        spaces_dict, 'spaces', _write_mode='overwrite')
        
        HB_rooms_.append(new_hb_room)
    
    PyPH_Rhino.gh_utils.object_preview( ventilation_schedule_ )
# ---------- end apply_ventilation_schedule ----------
# Digging this txt out_ format fosho
panel_5 = Panel(apply_ventilation_schedule.out)
panel_6 = Panel(python.HB_rooms)
brep_2 = Brep(python.volume_geometry_breps)
brep_3 = Brep(python.floor_surface_breps)
join = BrepJoin(Breps=brep_2)  # -> Breps, Closed

bang = ExplodeTree(Data=graft(apply_ventilation_schedule.HB_rooms))  # -> flatten(_0000), flatten(_0001), _0002
partition_2 = PartitionList(List=apply_ventilation_schedule.HB_rooms, Size="2")

create_variant = GhPythonScript(variant_name="My First Variant", HB_rooms=bang._0000)  # -> out, HB_rooms; inputs HB_rooms: list
# ---------- create_variant: Python ----------
import LBT_Utils
import PyPH_Rhino
import PyPH_Rhino.variants

reload(LBT_Utils)
reload(PyPH_Rhino)
reload(PyPH_Rhino.variants)

#-- Build the new Variant Identifier
new_variant = PyPH_Rhino.variants.Variant_Identifier()
new_variant.name = _variant_name or 'default_variant'

#-- Add the Ventilation Pattern to all the input HB Rooms
HB_rooms_ = []
for room in _HB_rooms:
    new_hb_room = room.duplicate()
    
    d = new_variant.to_dict()
    
    new_hb_room = LBT_Utils.user_data.add_to_HB_Obj_user_data(new_hb_room,
                                    d, 'variant_id', _write_mode='overwrite')
    
    HB_rooms_.append(new_hb_room)
# ---------- end create_variant ----------
create_variant_2 = GhPythonScript(variant_name="My Second Variant", HB_rooms=bang._0001)  # -> out, HB_rooms; inputs HB_rooms: list; same code as create_variant
pyph_update_scripts = PyPH_Update(run=Button())
# ---------- pyph_update_scripts: Python ----------
"""
Updates the python files for the PyPH Rhino Scripts folders. Updates Scripts\PHX and Scripts\PyPH_Rhino
---
Source: \\Mac\Home\Dropbox\bldgtyp-00\00_PH_Tools\PyPH\...
Target: C:\Users\edpma\AppData\Roaming\McNeel\Rhinoceros\7.0\scripts\...

"""

import os
import shutil
import scriptcontext as sc
import time

ghenv.Component.Name = "PyPH_Update"
ghenv.Component.NickName = "PyPH Update Scripts"
ghenv.Component.Message = 'JUL_29_2021'
ghenv.Component.IconDisplayMode = ghenv.Component.IconDisplayMode.application
ghenv.Component.Category = "PH-Tools"
ghenv.Component.SubCategory = "04 | DEV"

#--- Set up the path variables
SRC_DEV_FOLDER_PATH = r"\\Mac\Home\Dropbox\bldgtyp-00\00_PH_Tools\PyPH"
SRC_PHX_PATH = SRC_DEV_FOLDER_PATH + r"\PHX"
SRC_PYPH_RHINO_PATH = SRC_DEV_FOLDER_PATH + r"\PyPH_Rhino"
SRC_LBT_UTILS_PATH = SRC_DEV_FOLDER_PATH + r"\LBT_Utils"

TRGT_SCRIPTS_PATH = r"C:\Users\edpma\AppData\Roaming\McNeel\Rhinoceros\7.0\scripts"
TRGT_PHX_PATH = TRGT_SCRIPTS_PATH + r"\PHX"
TRGT_PYPH_RHINO_PATH = TRGT_SCRIPTS_PATH + r"\PyPH_Rhino"
TRGT_LBT_UTILS_PATH = TRGT_SCRIPTS_PATH + r"\LBT_Utils"

#--- Check
#assert os.path.exists(SRC_DEV_FOLDER_PATH), 'MISSING: {}'.format(SRC_DEV_FOLDER_PATH)
#assert os.path.exists(SRC_PHX_PATH), 'MISSING: {}'.format(SRC_PHX_PATH)
#assert os.path.exists(SRC_PYPH_RHINO_PATH), 'MISSING: {}'.format(SRC_PYPH_RHINO_PATH)
#assert os.path.exists(TRGT_SCRIPTS_PATH), 'MISSING: {}'.format(TRGT_SCRIPTS_PATH)
#assert os.path.exists(TRGT_PHX_PATH), 'MISSING: {}'.format(TRGT_PHX_PATH)
#assert os.path.exists(TRGT_PYPH_RHINO_PATH), 'MISSING: {}'.format(TRGT_PYPH_RHINO_PATH)

def copy_all_files_in_folder(src_dir, target_dir):
    
    if not os.path.exists(target_dir):
        os.mkdir(target_dir)
    
    src_files = {k:os.path.join( src_dir, k ) for k in os.listdir(src_dir)}
    trgt_files = {k:os.path.join( target_dir, k ) for k in os.listdir(target_dir)}
    any_work_done = False
    
    #-- Files
    for file_name, file_path in src_files.items():
        #--- Filter out:
        if file_name[0] == '.': continue
        if file_name == '__pycache__': continue
        if not os.path.isfile(file_path): continue
        
        #--- If it doesn't exist, just copy it over
        if file_name not in trgt_files:
            trgt_file_path = os.path.join( target_dir, file_name )
            print 'Copying: {} to {}'.format(file_path, trgt_file_path)
            shutil.copyfile(file_path, trgt_file_path)
            any_work_done = True
        else:
            trgt_file_path = trgt_files[file_name]
        
        #--- if the source is newer, copy over
        if os.path.getmtime(file_path) > os.path.getmtime(trgt_file_path):
            print 'Copying: {} to {}'.format(file_path, trgt_file_path)
            shutil.copyfile(file_path, trgt_file_path)
            any_work_done = True
    
    #-- Subfolders
    for file_name, file_path in src_files.items():
        #--- Filter out:
        if file_name[0] == '.': continue
        if file_name == '__pycache__': continue
        if not os.path.isdir(file_path): continue
        
        #--- Walk through the Folder tree
        target_dir = os.path.join(target_dir, file_name)
        copy_all_files_in_folder(file_path, target_dir)
        
        



def update(_src, _target, _sleep_time=0):
    #Closure
    src_dir = _src
    target_dir = _target
    #sleep_time = _sleep_time
    
    def closure():
        #--- Copy Over
        copy_all_files_in_folder(src_dir, target_dir)
        
        # Give some time for the files to update / get copied over
        # Not sure if this is needed, but adds some buffer
        #if any_work_done:
            #time.sleep(sleep_time)
    
    return closure

# Add the update funcs to the sticky dict so the components can use them
#if _add_to_sticky:
#    sc.sticky['PyPH_Update_PHX'] = update(SRC_PHX_PATH, TRGT_PHX_PATH, 1)
#    sc.sticky['PyPH_Update_PyPH'] = update(SRC_PYPH_RHINO_PATH, TRGT_PYPH_RHINO_PATH, 1)
#    sc.sticky['PyPH_Update_LBT_Utils'] = update(SRC_LBT_UTILS_PATH, TRGT_LBT_UTILS_PATH, 1)

print SRC_PHX_PATH, TRGT_PHX_PATH
print SRC_PYPH_RHINO_PATH, TRGT_PYPH_RHINO_PATH
print SRC_LBT_UTILS_PATH, TRGT_LBT_UTILS_PATH


if _run:
    update(SRC_PHX_PATH, TRGT_PHX_PATH)()
    update(SRC_PYPH_RHINO_PATH, TRGT_PYPH_RHINO_PATH)()
    update(SRC_LBT_UTILS_PATH, TRGT_LBT_UTILS_PATH)()
# ---------- end pyph_update_scripts ----------
merge_2 = Merge(Data1=create_variant.HB_rooms, Data2=create_variant_2.HB_rooms, Data3=bang._0002)  # -> flatten(Result)
panel_7 = Panel(merge_2)
model = HBModel(rooms=flatten(merge_2), name="My_Example_Model")  # -> report, model; plug-in component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
vizbytype = HBVisualizeByType(hb_objs=model.model)  # -> walls, interior_walls, roofs, ceilings, exterior_floors, interior_floors, air_walls, apertures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; plug-in component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
path = FilePath("\\Mac\Dropbox\bldgtyp-00\00_PH_Tools\PyPH\sample\EM_sample_input_HBJSON\")
dumpobjects = HBDumpObjects(hb_objs=flatten(model.model), name="Sample_Input", folder=path, indent="4", dump=Toggle(False))  # -> report, hb_file; plug-in component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
panel_8 = Panel(dumpobjects.hb_file)

# ==== cluster Extrude
B = ClusterInput()

debrep = DeconstructBrep(Brep=B)  # -> Faces, Edges, Vertices
join = JoinCurves(Curves=debrep.Edges, Preserve=False)  # -> flatten(Curves)
sunion = SolidUnion(Breps=join)
fmerge = MergeFaces(Brep=sunion)  # -> Breps, Before, After
debrep_2 = DeconstructBrep(Brep=fmerge.Breps)  # -> Faces, Edges, Vertices
join_2 = JoinCurves(Curves=debrep_2.Edges, Preserve=False)  # -> flatten(Curves)
Z = UnitZ(Factor=Slider(5, range=0..12))
move = Move(Geometry=debrep_2.Faces, Motion=Z)  # -> flatten(Geometry), Transform
extr = Extrude(Base=join_2, Direction=Z)
join_3 = BrepJoin(Breps=flatten([move.Geometry, extr]))  # -> Breps, Closed

B_2 = ClusterOutput(join_3.Breps)
