# Grasshopper definition 210729.gh (Grasshopper 1.0.7)

box = Box2Pt(PointA="0,0,0", PointB="10,10,3", Plane=PlaneXY(0, 0, 0))
box_2 = Box2Pt(PointA="10,0,0", PointB="20,10,3", Plane=PlaneXY(0, 0, 0))
roomsolid = HBRoomFromSolid(geo=flatten([box, box_2]), conditioned=True)  # -> report, rooms; plug-in component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
toggle = BooleanToggle(True)
solveadj = HBSolveAdjacency(rooms=flatten(roomsolid.rooms), overwrite=toggle, run=toggle)  # -> report, adj_rooms; plug-in component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
aperturesbyratio = HBAperturesByRatio(hb_objs=flatten(solveadj.adj_rooms), ratio="0.2")  # -> report, hb_objs; plug-in component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

pyph_update_scripts = PyPH_Update(run=Button())
# ---------- pyph_update_scripts: Python ----------
"""
Updates the python files for the PyPH Rhino Scripts folders. Updates Scripts\PHX and Scripts\PyPH_Rhino
---
Source: \\Mac\Home\Dropbox\bldgtyp-00\00_PH_Tools\PyPH\...
Target: C:\Users\edpma\AppData\Roaming\McNeel\Rhinoceros\7.0\scripts\...

"""

import os
import shutil
import scriptcontext as sc
import time

ghenv.Component.Name = "PyPH_Update"
ghenv.Component.NickName = "PyPH Update Scripts"
ghenv.Component.Message = 'JUL_29_2021'
ghenv.Component.IconDisplayMode = ghenv.Component.IconDisplayMode.application
ghenv.Component.Category = "PH-Tools"
ghenv.Component.SubCategory = "04 | DEV"

#--- Set up the path variables
SRC_DEV_FOLDER_PATH = r"\\Mac\Home\Dropbox\bldgtyp-00\00_PH_Tools\PyPH"
SRC_PHX_PATH = SRC_DEV_FOLDER_PATH + r"\PHX"
SRC_PYPH_RHINO_PATH = SRC_DEV_FOLDER_PATH + r"\PyPH_Rhino"
SRC_LBT_UTILS_PATH = SRC_DEV_FOLDER_PATH + r"\LBT_Utils"

TRGT_SCRIPTS_PATH = r"C:\Users\edpma\AppData\Roaming\McNeel\Rhinoceros\7.0\scripts"
TRGT_PHX_PATH = TRGT_SCRIPTS_PATH + r"\PHX"
TRGT_PYPH_RHINO_PATH = TRGT_SCRIPTS_PATH + r"\PyPH_Rhino"
TRGT_LBT_UTILS_PATH = TRGT_SCRIPTS_PATH + r"\LBT_Utils"

#--- Check
#assert os.path.exists(SRC_DEV_FOLDER_PATH), 'MISSING: {}'.format(SRC_DEV_FOLDER_PATH)
#assert os.path.exists(SRC_PHX_PATH), 'MISSING: {}'.format(SRC_PHX_PATH)
#assert os.path.exists(SRC_PYPH_RHINO_PATH), 'MISSING: {}'.format(SRC_PYPH_RHINO_PATH)
#assert os.path.exists(TRGT_SCRIPTS_PATH), 'MISSING: {}'.format(TRGT_SCRIPTS_PATH)
#assert os.path.exists(TRGT_PHX_PATH), 'MISSING: {}'.format(TRGT_PHX_PATH)
#assert os.path.exists(TRGT_PYPH_RHINO_PATH), 'MISSING: {}'.format(TRGT_PYPH_RHINO_PATH)

def copy_all_files_in_folder(src_dir, target_dir):
    
    if not os.path.exists(target_dir):
        os.mkdir(target_dir)
    
    src_files = {k:os.path.join( src_dir, k ) for k in os.listdir(src_dir)}
    trgt_files = {k:os.path.join( target_dir, k ) for k in os.listdir(target_dir)}
    any_work_done = False
    
    #-- Files
    for file_name, file_path in src_files.items():
        #--- Filter out:
        if file_name[0] == '.': continue
        if file_name == '__pycache__': continue
        if not os.path.isfile(file_path): continue
        
        #--- If it doesn't exist, just copy it over
        if file_name not in trgt_files:
            trgt_file_path = os.path.join( target_dir, file_name )
            print 'Copying: {} to {}'.format(file_path, trgt_file_path)
            shutil.copyfile(file_path, trgt_file_path)
            any_work_done = True
        else:
            trgt_file_path = trgt_files[file_name]
        
        #--- if the source is newer, copy over
        if os.path.getmtime(file_path) > os.path.getmtime(trgt_file_path):
            print 'Copying: {} to {}'.format(file_path, trgt_file_path)
            shutil.copyfile(file_path, trgt_file_path)
            any_work_done = True
    
    #-- Subfolders
    for file_name, file_path in src_files.items():
        #--- Filter out:
        if file_name[0] == '.': continue
        if file_name == '__pycache__': continue
        if not os.path.isdir(file_path): continue
        
        #--- Walk through the Folder tree
        target_dir = os.path.join(target_dir, file_name)
        copy_all_files_in_folder(file_path, target_dir)
        
        



def update(_src, _target, _sleep_time=0):
    #Closure
    src_dir = _src
    target_dir = _target
    #sleep_time = _sleep_time
    
    def closure():
        #--- Copy Over
        copy_all_files_in_folder(src_dir, target_dir)
        
        # Give some time for the files to update / get copied over
        # Not sure if this is needed, but adds some buffer
        #if any_work_done:
            #time.sleep(sleep_time)
    
    return closure

# Add the update funcs to the sticky dict so the components can use them
#if _add_to_sticky:
#    sc.sticky['PyPH_Update_PHX'] = update(SRC_PHX_PATH, TRGT_PHX_PATH, 1)
#    sc.sticky['PyPH_Update_PyPH'] = update(SRC_PYPH_RHINO_PATH, TRGT_PYPH_RHINO_PATH, 1)
#    sc.sticky['PyPH_Update_LBT_Utils'] = update(SRC_LBT_UTILS_PATH, TRGT_LBT_UTILS_PATH, 1)

print SRC_PHX_PATH, TRGT_PHX_PATH
print SRC_PYPH_RHINO_PATH, TRGT_PYPH_RHINO_PATH
print SRC_LBT_UTILS_PATH, TRGT_LBT_UTILS_PATH


if _run:
    update(SRC_PHX_PATH, TRGT_PHX_PATH)()
    update(SRC_PYPH_RHINO_PATH, TRGT_PYPH_RHINO_PATH)()
    update(SRC_LBT_UTILS_PATH, TRGT_LBT_UTILS_PATH)()
# ---------- end pyph_update_scripts ----------
vent_schedule = LBT2PHVentSchedule()  # -> out, phpp_ventilation_sched; plug-in component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
ventilastion_schedule = GhPythonScript(fan_speed_at_high="0.2", hours_at_high="12")  # -> out, ventilation_schedule
# ---------- ventilastion_schedule: Python ----------
import Grasshopper.Kernel as ghK

import PHX
import PHX._base
import PHX.utilization_patterns
import PyPH_Rhino.gh_utils

reload(PHX)
reload(PHX._base)
reload(PHX.utilization_patterns)
reload(PyPH_Rhino.gh_utils)


ventilation_schedule_ = PHX.utilization_patterns.UtilizationPattern_Ventilation()

ventilation_schedule_.utilizations.maximum.frac_of_design_airflow = _fan_speed_at_high or 0
ventilation_schedule_.utilizations.maximum.daily_op_sched = _hours_at_high or 0

ventilation_schedule_.utilizations.standard.frac_of_design_airflow = _fan_speed_at_normal or 0
ventilation_schedule_.utilizations.standard.daily_op_sched = _hours_at_normal or 0

ventilation_schedule_.utilizations.basic.frac_of_design_airflow = _fan_speed_at_low or 0
ventilation_schedule_.utilizations.basic.daily_op_sched = _hours_at_low or 0

ventilation_schedule_.utilizations.minimum.frac_of_design_airflow = _fan_speed_at_minimum or 0
ventilation_schedule_.utilizations.minimum.daily_op_sched = _hours_at_minimum or 0



msg = ventilation_schedule_.validate_total_hours()
if msg:
    ghenv.Component.AddRuntimeMessage(ghK.GH_RuntimeMessageLevel.Warning, msg)

PyPH_Rhino.gh_utils.object_preview( ventilation_schedule_ )
# ---------- end ventilastion_schedule ----------
panel = Panel(ventilastion_schedule.out)
pipeline = GeometryPipeline(
    GroupByLayer=False,
    GroupByType=False,
    IncludeHidden=True,
    IncludeLocked=True,
    LayerFilter="Default",
    NameFilter="*",
    SublayerFiltering=True,
    TypeFilter=1073741885)

debrep = DeconstructBrep(Brep=pipeline)  # -> Faces, Edges, Vertices
join = JoinCurves(Curves=debrep.Edges, Preserve=False)  # -> flatten(Curves)
sunion = SolidUnion(Breps=join)
fmerge = MergeFaces(Brep=sunion)  # -> Breps, Before, After
debrep_2 = DeconstructBrep(Brep=fmerge.Breps)  # -> Faces, Edges, Vertices
join_2 = JoinCurves(Curves=debrep_2.Edges, Preserve=False)  # -> flatten(Curves)
Z = UnitZ(Factor=Slider(5, range=0..12))
move = Move(Geometry=debrep_2.Faces, Motion=Z)  # -> flatten(Geometry), Transform
extr = Extrude(Base=join_2, Direction=Z)
join_3 = BrepJoin(Breps=flatten([move.Geometry, extr]))  # -> Breps, Closed

brep = Brep(join_3.Breps)
partition = PartitionList(List=brep, Size="2")
item = ListItem(List=partition, Index="0", Wrap=True)  # -> flatten(Item)
phpp_spaces = LBT2PHCreatePHPPSpaces()  # -> out, space_breps, phpp_spaces, HB_rooms; inputs TFA_surfaces: list, spaces_geometry: list of Guid, HB_rooms: list, set_honeybee_loads: Boolean; plug-in component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
python = GhPythonScript(floor_surfaces=pipeline, space_geometry=item, HB_rooms=aperturesbyratio.hb_objs)  # -> out, floor_surface_breps, volume_geometry_breps, HB_rooms; inputs floor_surfaces: list, space_geometry: list, HB_rooms: list
# ---------- python: Python ----------
import scriptcontext as sc
import Rhino as rh
import rhinoscriptsyntax as rs
import ghpythonlib.components as ghc
import Grasshopper as gh


import LBT_Utils
reload(LBT_Utils)

import PHX
import PHX._base
import PHX.utilization_patterns
import PHX.hvac
import PHX.geometry
import PHX.spaces
import PHX.serialization.to_dict
import PHX.serialization.from_dict

reload(PHX)
reload(PHX._base)
reload(PHX.utilization_patterns)
reload(PHX.hvac)
reload(PHX.geometry)
reload(PHX.spaces)
reload(PHX.serialization.to_dict)
reload(PHX.serialization.from_dict)

import PyPH_Rhino
import PyPH_Rhino.gh_io
import PyPH_Rhino.spaces
import PyPH_Rhino.space_floors
import PyPH_Rhino.space_volumes
import PyPH_Rhino.space_io

reload(PyPH_Rhino)
reload(PyPH_Rhino.gh_io)
reload(PyPH_Rhino.spaces)
reload(PyPH_Rhino.space_floors)
reload(PyPH_Rhino.space_volumes)
reload(PyPH_Rhino.space_io)




"""
DEV = True
if DEV:
    sc.sticky.get('PyPH_Update_PHX', lambda : None)()
    sc.sticky.get('PyPH_Update_PyPH', lambda : None)()
"""
IGH = PyPH_Rhino.gh_io.IGH( ghdoc, ghenv, sc, rh, rs, ghc, gh )


#--- Main
if _HB_rooms:
    floors_dict, floor_surface_breps_ = PyPH_Rhino.spaces.build_floors(IGH,
                                    _floor_surfaces, '_floor_surfaces', _HB_rooms)
    volumes, volume_geometry_breps_ = PyPH_Rhino.spaces.build_volumes(IGH, 
                                    floors_dict, _space_geometry, '_space_geometry')
    spaces = PyPH_Rhino.spaces.build_spaces(volumes)


#-- 5) Set each space's fresh-air flow rates
for hb_room_name, space_list in spaces.items():
    for space in space_list.get('Spaces'):
        pass#print space.ventilation.ventilator.to_dict()
    




#--- Pack up all the results onto the HB Rooms
HB_rooms_ = []
for hb_room in _HB_rooms:
    new_hb_room = hb_room.duplicate()
    
    spaces_dict = {}
    for space in spaces.get(hb_room.identifier, {}).get('Spaces', []):
        spaces_dict.update( { id(space):space.to_dict() } )
    
    new_hb_room = LBT_Utils.user_data.add_to_HB_Obj_user_data(new_hb_room,
                                    spaces_dict, 'spaces', _write_mode='overwrite')
    
    HB_rooms_.append(new_hb_room)
# ---------- end python ----------
phpp_spaces_2 = LBT2PHCreatePHPPSpaces()  # -> out, space_breps, phpp_spaces, HB_rooms; inputs TFA_surfaces: list, spaces_geometry: list of Guid, HB_rooms: list, set_honeybee_loads: Boolean; disabled; plug-in component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
panel_2 = Panel(aperturesbyratio.hb_objs)  # disabled
brep_2 = Brep(python.volume_geometry_breps)
brep_3 = Brep(python.floor_surface_breps)
model = HBModel(rooms=flatten(python.HB_rooms), name="My_Example_Model")  # -> report, model; plug-in component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
vizbytype = HBVisualizeByType(hb_objs=model.model)  # -> walls, interior_walls, roofs, ceilings, exterior_floors, interior_floors, air_walls, apertures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; plug-in component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
join_4 = BrepJoin(Breps=brep_2)  # -> Breps, Closed
panel_3 = Panel(join_4.Breps)
panel_4 = Panel(brep_3)
panel_5 = Panel(python.HB_rooms)
path = FilePath("\\Mac\Dropbox\bldgtyp-00\00_PH_Tools\PyPH\sample\EM_sample_input_HBJSON\")
dumpobjects = HBDumpObjects(hb_objs=flatten(model.model), name="Sample_Input", folder=path, indent="4", dump=Toggle(False))  # -> report, hb_file; plug-in component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
panel_6 = Panel(dumpobjects.hb_file)
